% Simulink data dictionary Roadsense_Data.sldd

RsCameraFrameBus = Simulink.Bus()  % Fixed-size RGB camera frame and acquisition metadata.
  Timestamp: double, Unit="s"  % Camera exposure time.
  FrameID: uint32  % Monotonically increasing camera frame identifier.
  Image: uint8[480 640 3]  % RGB image in row-column-channel order.
  Valid: boolean  % True when the image and metadata are usable.

RsImageSemanticBus = Simulink.Bus()  % Image-plane semantic evidence produced by camera AI.
  Timestamp: double, Unit="s"  % Source camera exposure time.
  FrameID: uint32  % Source camera frame identifier.
  SemanticLabel: uint8[120 160]  % Numeric RoadsenseTypes.SemanticClass code.
  Confidence: single[120 160], Min=0, Max=1  % Winning-class probability in [0,1].
  DrivableProbability: single[120 160], Min=0, Max=1  % Road/drivable confidence in [0,1].
  InferenceTime: single, Unit="s"  % Measured wall-clock semantic inference time.
  NetworkReady: boolean  % True when a trained network was loaded.
  Valid: boolean  % True when this output came from a valid image and successful inference.

RsCameraObjectListBus = Simulink.Bus()  % Camera object regions derived from semantic AI or a future dedicated detector.
  Timestamp: double, Unit="s"  % Source camera exposure time.
  FrameID: uint32  % Source camera frame identifier.
  Count: uint16  % Number of valid leading object entries.
  BoundingBoxes: single[256 4]  % Image boxes [x y width height] in pixels.
  ClassIDs: uint8[256 1]  % Numeric RoadsenseTypes.ObjectClass code.
  Scores: single[256 1], Min=0, Max=1  % Detection confidence in [0,1].
  Positions: single[256 3], Unit="m"  % Approximate ego-frame [x y z] ground positions.
  PositionCovariances: single[3 3 256], Unit="m^2"  % Ground-position covariance per object.
  ValidMask: boolean[256 1]  % True for each populated object slot.
  InputImageSize: uint16[2 1]  % Input [height;width] in pixels.
  InferenceTime: single, Unit="s"  % Shared semantic inference and postprocessing time.
  NetworkReady: boolean  % True when a trained network was loaded.
  Overflow: boolean  % True when object regions exceeded capacity.
  Valid: boolean  % True when this output came from successful inference.

RsLidarFrameBus = Simulink.Bus()  % Normalized, fixed-capacity LiDAR point cloud.
  Timestamp: double, Unit="s"  % LiDAR acquisition time.
  FrameID: uint32  % Monotonically increasing LiDAR frame identifier.
  Count: uint32  % Number of valid leading point entries.
  Points: single[120000 3], Unit="m"  % Ego-frame [forward left up] points.
  Intensity: single[120000 1], Min=0, Max=1  % Normalized return intensity in [0,1].
  Overflow: boolean  % True when the source scan exceeded fixed capacity.
  Valid: boolean  % True when metadata and point data are usable.

RsLidarGridEvidenceBus = Simulink.Bus()  % LiDAR-derived occupancy and road-surface evidence in the ego grid.
  Timestamp: double, Unit="s"  % Source LiDAR acquisition time.
  FrameID: uint32  % Source LiDAR frame identifier.
  Resolution: single, Unit="m"  % Metres per grid cell.
  XLimits: single[2 1], Unit="m"  % Longitudinal ego-frame bounds [min;max].
  YLimits: single[2 1], Unit="m"  % Lateral ego-frame bounds [min;max].
  Occupancy: single[200 320], Min=0, Max=1  % Non-ground occupancy confidence in [0,1].
  GroundHeight: single[200 320], Unit="m"  % Observed ground height relative to ego origin.
  Roughness: single[200 320], Unit="m"  % Ground-height standard deviation.
  PotholeProbability: single[200 320], Min=0, Max=1  % Depressed-surface probability in [0,1].
  SurfaceCost: single[200 320], Min=0, Max=1  % Combined roughness/depression cost in [0,1].
  ObservedMask: boolean[200 320]  % Cells containing at least one LiDAR return.
  ProcessingTime: single, Unit="s"  % Measured wall-clock processing time.
  Valid: boolean  % True when grid evidence was produced successfully.

RsLidarObjectListBus = Simulink.Bus()  % Geometric object clusters produced by LiDAR perception.
  Timestamp: double, Unit="s"  % Source LiDAR acquisition time.
  FrameID: uint32  % Source LiDAR frame identifier.
  Count: uint16  % Number of valid leading object entries.
  Positions: single[256 3], Unit="m"  % Ego-frame cluster centroids.
  Dimensions: single[256 3], Unit="m"  % Oriented [length width height] estimates.
  Yaws: single[256 1], Unit="rad"  % Principal-axis cluster headings.
  ClassIDs: uint8[256 1]  % Numeric RoadsenseTypes.ObjectClass; unknown until classified.
  Scores: single[256 1], Min=0, Max=1  % Geometric detection confidence in [0,1].
  PositionCovariances: single[3 3 256], Unit="m^2"  % Centroid covariance per cluster.
  PointCounts: uint32[256 1]  % Number of LiDAR returns in each cluster.
  ValidMask: boolean[256 1]  % True for each populated cluster slot.
  ProcessingTime: single, Unit="s"  % Shared segmentation and clustering time.
  Overflow: boolean  % True when clusters exceeded capacity.
  Valid: boolean  % True when this output came from a valid scan.

RsRadarObjectListBus = Simulink.Bus()  % Fixed-capacity Cartesian radar detections for multi-sensor fusion.
  Timestamp: double, Unit="s"  % Radar measurement time.
  FrameID: uint32  % Monotonically increasing radar frame identifier.
  Count: uint16  % Number of valid leading object entries.
  Positions: single[256 3], Unit="m"  % Ego-frame radar positions [forward left up].
  Velocities: single[256 3], Unit="m/s"  % Ego-frame Cartesian velocity measurements.
  PositionCovariances: single[3 3 256], Unit="m^2"  % Position covariance per radar detection.
  VelocityCovariances: single[3 3 256], Unit="(m/s)^2"  % Velocity covariance per radar detection.
  Scores: single[256 1], Min=0, Max=1  % Radar detection confidence in [0,1].
  ValidMask: boolean[256 1]  % True for each populated radar slot.
  Overflow: boolean  % True when radar detections exceeded capacity.
  Valid: boolean  % True when radar data and metadata are usable.

RsEgoStateBus = Simulink.Bus()  % Time-stamped ego motion state.
  Timestamp: double, Unit="s"  % Scenario time.
  Position: double[3 1], Unit="m"  % Ego position [x;y;z] in the local world frame.
  Velocity: double[3 1], Unit="m/s"  % Ego velocity [vx;vy;vz] in the local world frame.
  Acceleration: double[3 1], Unit="m/s^2"  % Ego acceleration [ax;ay;az] in the local world frame.
  Yaw: double, Unit="rad"  % Counter-clockwise heading from +x.
  Pitch: double, Unit="rad"  % Ego pitch.
  Roll: double, Unit="rad"  % Ego roll.
  YawRate: double, Unit="rad/s"  % Ego yaw rate.
  SteeringAngle: double, Unit="rad"  % Road-wheel steering angle.
  Valid: boolean  % True when this sample is usable.

RsRouteContextBus = Simulink.Bus()  % Map-independent high-level route and scenario context.
  Timestamp: double, Unit="s"  % High-level route-context time.
  DesiredSpeed: single, Unit="m/s"  % Requested free-flow route speed.
  SpeedLimit: single, Unit="m/s"  % Current legal or scenario speed limit.
  DistanceToGoal: single, Unit="m"  % Remaining route distance.
  GoalReached: boolean  % True when the final stopping region is reached.
  AllowObstacleAvoidance: boolean  % True when lateral obstacle avoidance is route-permitted.
  UncontrolledIntersection: boolean  % True inside an unsignalized or informally controlled junction.
  OccludedArea: boolean  % True when visibility is insufficient for normal-speed entry.
  MergeRequired: boolean  % True while performing an informal or highway merge.
  Valid: boolean  % True when route context is current and usable.

RsReferencePathBus = Simulink.Bus()  % Lane-independent local route polyline expressed in the current ego frame.
  Timestamp: double, Unit="s"  % Reference-path generation time.
  Count: uint16  % Number of valid leading path samples.
  Positions: single[256 2], Unit="m"  % Current-ego-frame route guidance positions [x y].
  Yaws: single[256 1], Unit="rad"  % Route headings relative to current ego heading.
  RecommendedSpeeds: single[256 1], Unit="m/s"  % Optional route speed profile.
  ValidMask: boolean[256 1]  % True for each populated reference sample.
  Valid: boolean  % True when the reference polyline is usable.

RsSensorDetectionBus = Simulink.Bus()  % Normalized detection emitted by camera, lidar, radar, or reference sensing.
  Timestamp: double, Unit="s"  % Measurement time.
  DetectionID: uint32  % Detection identifier local to its source.
  SensorID: uint16  % Unique sensor identifier.
  SensorType: Enum: RoadsenseTypes.SensorType  % Measurement source.
  ClassID: Enum: RoadsenseTypes.ObjectClass  % Most probable semantic class.
  ClassConfidence: single, Min=0, Max=1  % Class probability in [0,1].
  Position: single[3 1], Unit="m"  % Measured [x;y;z] in ego coordinates.
  Velocity: single[3 1], Unit="m/s"  % Measured velocity in ego coordinates.
  Dimensions: single[3 1], Unit="m"  % Object [length;width;height].
  Yaw: single, Unit="rad"  % Object heading relative to ego +x.
  PositionCovariance: single[3 3], Unit="m^2"  % Position measurement covariance.
  VelocityCovariance: single[3 3], Unit="(m/s)^2"  % Velocity measurement covariance.
  HasVelocity: boolean  % True when velocity is measured.
  Valid: boolean  % True when this array slot contains a detection.

RsSensorDetectionArrayBus = Simulink.Bus()  % Fixed-capacity collection of normalized sensor detections.
  Timestamp: double, Unit="s"  % Array assembly time.
  Count: uint16  % Number of valid leading entries.
  Detections: Bus: RsSensorDetectionBus[256 1]  % Fixed-capacity detection array.
  Overflow: boolean  % True when detections exceeded capacity.

RsTrackedObjectBus = Simulink.Bus()  % Fused, time-stamped dynamic or static object track.
  Timestamp: double, Unit="s"  % Most recent filter time.
  TrackID: uint32  % Persistent tracker identifier.
  ClassID: Enum: RoadsenseTypes.ObjectClass  % Fused semantic class.
  ClassConfidence: single, Min=0, Max=1  % Fused class probability in [0,1].
  ExistenceProbability: single, Min=0, Max=1  % Track existence probability in [0,1].
  Position: single[3 1], Unit="m"  % Estimated [x;y;z] in ego coordinates.
  Velocity: single[3 1], Unit="m/s"  % Estimated velocity in ego coordinates.
  Acceleration: single[3 1], Unit="m/s^2"  % Estimated acceleration in ego coordinates.
  Yaw: single, Unit="rad"  % Estimated object heading relative to ego +x.
  YawRate: single, Unit="rad/s"  % Estimated object yaw rate.
  Dimensions: single[3 1], Unit="m"  % Estimated [length;width;height].
  StateCovariance: single[6 6]  % Covariance of [x;y;z;vx;vy;vz].
  Age: uint16  % Number of tracker update cycles.
  SensorMask: uint8  % Bit mask: camera=1, lidar=2, radar=4.
  IsConfirmed: boolean  % Tracker confirmation state.
  Valid: boolean  % True when this array slot contains a track.

RsTrackedObjectArrayBus = Simulink.Bus()  % Fixed-capacity collection of fused object tracks.
  Timestamp: double, Unit="s"  % Tracker output time.
  Count: uint16  % Number of valid leading entries.
  Objects: Bus: RsTrackedObjectBus[128 1]  % Fixed-capacity track array.
  Overflow: boolean  % True when tracks exceeded capacity.

RsFusedTrackListBus = Simulink.Bus()  % Flat fixed-capacity fused-track interface used by prediction and planning.
  Timestamp: double, Unit="s"  % Fusion update time.
  Count: uint16  % Number of valid leading track entries.
  TrackIDs: uint32[128 1]  % Persistent JPDA track identifiers.
  ClassIDs: uint8[128 1]  % Numeric RoadsenseTypes.ObjectClass codes.
  ClassConfidences: single[128 1], Min=0, Max=1  % Maximum fused class probability in [0,1].
  ExistenceProbabilities: single[128 1], Min=0, Max=1  % JIPDA existence probability in [0,1].
  Positions: single[128 3], Unit="m"  % Estimated ego-frame [x y z] positions.
  Velocities: single[128 3], Unit="m/s"  % Estimated ego-frame Cartesian velocities.
  Accelerations: single[128 3], Unit="m/s^2"  % Estimated acceleration; zero until an acceleration model is enabled.
  Yaws: single[128 1], Unit="rad"  % Velocity-derived object headings.
  YawRates: single[128 1], Unit="rad/s"  % Estimated yaw rates; zero for the present Cartesian IMM.
  Dimensions: single[128 3], Unit="m"  % Persisted [length width height] estimates.
  StateCovariances: single[6 6 128]  % Covariance ordered [x y z vx vy vz].
  Ages: uint16[128 1]  % Number of tracker update cycles.
  SensorMasks: uint8[128 1]  % Current supporting sensors: camera=1, lidar=2, radar=4.
  IsConfirmed: boolean[128 1]  % True after the probabilistic confirmation threshold is met.
  ValidMask: boolean[128 1]  % True for each populated output track.
  ProcessingTime: single, Unit="s"  % Measured wall-clock association and tracking time.
  SourceOverflow: boolean  % True when any upstream object list overflowed.
  Overflow: boolean  % True when output tracks exceeded fixed capacity.
  Valid: boolean  % True when the fusion update executed with a valid timestamp.

RsPredictedTrajectoryBus = Simulink.Bus()  % Fixed-horizon multimodal prediction for one tracked object.
  Timestamp: double, Unit="s"  % Prediction generation time.
  TrackID: uint32  % Source track identifier.
  ClassID: Enum: RoadsenseTypes.ObjectClass  % Source semantic class.
  NumModes: uint8  % Number of valid leading motion modes.
  NumSteps: uint8  % Number of valid leading time steps.
  TimeOffsets: single[16 1], Unit="s"  % Future time relative to Timestamp.
  ModeProbabilities: single[4 1]  % Mode probabilities; valid values sum to one.
  Positions: single[2 16 4], Unit="m"  % Predicted ego-frame [x;y] by step and mode.
  Yaws: single[16 4], Unit="rad"  % Predicted headings by step and mode.
  PositionCovariances: single[2 2 16 4], Unit="m^2"  % Predicted 2-D covariance by step and mode.
  Valid: boolean  % True when this array slot contains a prediction.

RsPredictionArrayBus = Simulink.Bus()  % Fixed-capacity collection of object predictions.
  Timestamp: double, Unit="s"  % Prediction output time.
  Count: uint16  % Number of valid leading entries.
  Predictions: Bus: RsPredictedTrajectoryBus[128 1]  % One prediction slot per possible track.
  Overflow: boolean  % True when predictions exceeded capacity.

RsMotionPredictionListBus = Simulink.Bus()  % Flat fixed-capacity multimodal motion predictions for map and planner use.
  Timestamp: double, Unit="s"  % Prediction generation time.
  Count: uint16  % Number of valid leading predicted objects.
  TrackIDs: uint32[128 1]  % Source fused-track identifiers.
  ClassIDs: uint8[128 1]  % Numeric RoadsenseTypes.ObjectClass codes.
  NumModes: uint8[128 1]  % Number of valid modes for each object.
  NumSteps: uint8  % Number of valid common prediction samples.
  TimeOffsets: single[16 1], Unit="s"  % Future times relative to Timestamp.
  ModeProbabilities: single[128 4], Min=0, Max=1  % Per-object mode probabilities; valid rows sum to one.
  Positions: single[128 16 4 2], Unit="m"  % Predicted current-ego-frame [x y] positions.
  Yaws: single[128 16 4], Unit="rad"  % Predicted headings by object, step, and mode.
  PositionCovariances: single[2 2 16 4 128], Unit="m^2"  % Per-mode 2-D position covariance.
  ValidMask: boolean[128 1]  % True for each populated prediction slot.
  ProcessingTime: single, Unit="s"  % Measured wall-clock prediction time.
  Overflow: boolean  % True when input tracks exceeded prediction capacity.
  Valid: boolean  % True when prediction completed for a valid track list.

RsSemanticGridBus = Simulink.Bus()  % Ego-fixed semantic traversability grid. Rows increase with +y; columns with +x.
  Timestamp: double, Unit="s"  % Grid fusion time.
  Resolution: single, Unit="m"  % Metres per grid cell.
  XLimits: single[2 1], Unit="m"  % Longitudinal ego-frame bounds [min;max].
  YLimits: single[2 1], Unit="m"  % Lateral ego-frame bounds [min;max].
  StaticOccupancy: single[200 320], Min=0, Max=1  % LiDAR/static occupancy probability in [0,1].
  DynamicOccupancy: single[200 320], Min=0, Max=1  % Current tracked-object footprint occupancy in [0,1].
  PredictedRisk: single[200 320], Min=0, Max=1  % Time-decayed multimodal future occupancy risk in [0,1].
  Occupancy: single[200 320], Min=0, Max=1  % Combined current static and dynamic occupancy in [0,1].
  Drivability: single[200 320], Min=0, Max=1  % Drivable probability in [0,1].
  SurfaceCost: single[200 320], Min=0, Max=1  % Normalized surface penalty in [0,1].
  CombinedCost: single[200 320], Min=0, Max=1  % Combined occupancy, future-risk, surface, and non-drivability cost.
  SemanticLabel: uint8[200 320]  % Numeric RoadsenseTypes.SemanticClass code.
  ObservedMask: boolean[200 320]  % True for cells observed by at least one sensor.
  ProcessingTime: single, Unit="s"  % Measured wall-clock map-fusion time.
  SourceOverflow: boolean  % True when any bounded upstream list overflowed.
  Valid: boolean  % True when geometry and grid channels are consistent.

RsTrajectoryPointBus = Simulink.Bus()  % One time-parameterized ego trajectory sample.
  TimeFromStart: single, Unit="s"  % Time relative to plan Timestamp.
  Position: single[2 1], Unit="m"  % Planned local-world [x;y].
  Yaw: single, Unit="rad"  % Planned heading.
  Speed: single, Unit="m/s"  % Planned signed speed.
  Acceleration: single, Unit="m/s^2"  % Planned longitudinal acceleration.
  Curvature: single, Unit="1/m"  % Planned path curvature.
  SteeringAngle: single, Unit="rad"  % Feed-forward road-wheel angle.

RsPlannedTrajectoryBus = Simulink.Bus()  % Selected, time-parameterized ego trajectory.
  Timestamp: double, Unit="s"  % Plan generation time.
  PlanID: uint32  % Monotonically increasing plan identifier.
  Count: uint16  % Number of valid leading points.
  Points: Bus: RsTrajectoryPointBus[61 1]  % Fixed-capacity trajectory points.
  TotalCost: single  % Winning candidate cost.
  MinimumClearance: single, Unit="m"  % Predicted minimum footprint clearance.
  Valid: boolean  % True when the trajectory is safe and feasible.

RsLocalPlanBus = Simulink.Bus()  % Flat selected local trajectory and planner diagnostics.
  Timestamp: double, Unit="s"  % Plan generation time.
  PlanID: uint32  % Monotonically increasing local-plan identifier.
  Count: uint16  % Number of valid leading trajectory samples.
  TimeFromStart: single[61 1], Unit="s"  % Trajectory time relative to Timestamp.
  Positions: single[61 2], Unit="m"  % Selected local-world positions [x y].
  Yaws: single[61 1], Unit="rad"  % Selected local-world headings.
  Speeds: single[61 1], Unit="m/s"  % Planned nonnegative longitudinal speed.
  Accelerations: single[61 1], Unit="m/s^2"  % Planned longitudinal acceleration.
  Curvatures: single[61 1], Unit="1/m"  % Signed path curvature.
  SteeringAngles: single[61 1], Unit="rad"  % Bicycle-model feed-forward road-wheel angle.
  TotalCost: single  % Winning candidate objective value.
  MinimumClearance: single, Unit="m"  % Minimum predicted footprint clearance.
  CandidateCount: uint16  % Number of sampled candidate trajectories.
  FeasibleCount: uint16  % Candidates passing all hard constraints.
  EmergencyFallback: boolean  % True when the minimum-risk braking fallback was used.
  Valid: boolean  % True when a bounded trajectory was produced.

RsPlannerStatusBus = Simulink.Bus()  % Planner health, timing, and decision status.
  Timestamp: double, Unit="s"  % Status generation time.
  PlanID: uint32  % Associated plan identifier.
  Code: Enum: RoadsenseTypes.PlannerCode  % Planner outcome.
  Behaviour: Enum: RoadsenseTypes.BehaviourMode  % Active supervisory state.
  CandidateCount: uint16  % Candidates evaluated.
  FeasibleCount: uint16  % Candidates passing all hard constraints.
  ExecutionTime: single, Unit="s"  % Measured wall-clock planning latency.
  Deadline: single, Unit="s"  % Allowed planning latency.
  ReplanRequested: boolean  % True when another plan is required.
  EmergencyRequested: boolean  % True when safety fallback is required.

RsBehaviourCommandBus = Simulink.Bus()  % Stateful supervisory command consumed by local trajectory planning.
  Timestamp: double, Unit="s"  % Behaviour decision time.
  SequenceID: uint32  % Incremented whenever the supervisory mode changes.
  Mode: Enum: RoadsenseTypes.BehaviourMode  % Selected supervisory driving mode.
  TargetSpeed: single, Unit="m/s"  % Speed objective supplied to trajectory generation.
  MaximumAcceleration: single, Unit="m/s^2"  % Upper longitudinal acceleration bound.
  MinimumAcceleration: single, Unit="m/s^2"  % Lower longitudinal acceleration bound.
  DesiredClearance: single, Unit="m"  % Minimum preferred obstacle clearance.
  StopDistance: single, Unit="m"  % Current conservative stopping-distance estimate.
  LeadTrackID: uint32  % Selected lead object; zero when none.
  MinimumTTC: single, Unit="s"  % Minimum estimated time to collision; Inf when none.
  ForwardRisk: single, Min=0, Max=1  % Maximum relevant forward map risk in [0,1].
  UnknownFraction: single, Min=0, Max=1  % Fraction of the forward corridor not directly observed.
  ReasonMask: uint16  % Decision causes: invalid=1, collision=2, goal=4, vulnerable=8, lead=16, blocked=32, unknown=64, surface=128, junction=256.
  ReplanRequested: boolean  % True on a supervisory mode transition.
  EmergencyRequested: boolean  % True while emergency braking is commanded.
  Valid: boolean  % True when the command is safe to consume.

RsVehicleControlBus = Simulink.Bus()  % Actuator-neutral steering and longitudinal request from trajectory control.
  Timestamp: double, Unit="s"  % Control-command generation time.
  PlanID: uint32  % Plan being tracked.
  SteeringAngle: single, Unit="rad"  % Requested road-wheel steering angle.
  SteeringRate: single, Unit="rad/s"  % Applied steering-angle rate.
  AccelerationCommand: single, Unit="m/s^2"  % Requested signed longitudinal acceleration.
  Throttle: single, Min=0, Max=1  % Normalized propulsion command in [0,1].
  Brake: single, Min=0, Max=1  % Normalized service-brake command in [0,1].
  TargetSpeed: single, Unit="m/s"  % Active trajectory speed target.
  EmergencyStop: boolean  % True when the fail-safe braking command is active.
  Valid: boolean  % True when the command was generated from valid current state and plan data.

RsTrackingStatusBus = Simulink.Bus()  % Closed-loop trajectory tracking errors, reference selection, and limiter state.
  Timestamp: double, Unit="s"  % Tracking-status generation time.
  PlanID: uint32  % Plan being tracked.
  ReferenceIndex: uint16  % Selected trajectory reference sample.
  CrossTrackError: single, Unit="m"  % Signed path-normal ego displacement.
  HeadingError: single, Unit="rad"  % Wrapped reference-minus-ego heading error.
  SpeedError: single, Unit="m/s"  % Reference-minus-ego longitudinal speed.
  ReferenceCurvature: single, Unit="1/m"  % Selected trajectory curvature.
  ReferenceAge: single, Unit="s"  % Elapsed time since plan generation.
  SteeringSaturated: boolean  % True when angle or rate limiting changed steering.
  AccelerationSaturated: boolean  % True when acceleration or slew limiting changed the command.
  PlanExpired: boolean  % True when the trajectory horizon plus grace time elapsed.
  Valid: boolean  % True when errors were computed from usable state and plan inputs.

RsRoadConditionBus = Simulink.Bus()  % Local friction, grade, bank, and rolling resistance for vehicle simulation.
  Timestamp: double, Unit="s"  % Road-condition sample time.
  FrictionCoefficient: single  % Tyre-road friction coefficient.
  Grade: single, Unit="rad"  % Positive uphill longitudinal grade angle.
  Bank: single, Unit="rad"  % Positive left-up road bank angle.
  RollingResistance: single  % Rolling-resistance coefficient.
  Valid: boolean  % True when the road-condition sample is usable.

RsVehicleDynamicsStatusBus = Simulink.Bus()  % Dynamic-bicycle internal state and physical-limit diagnostics.
  Timestamp: double, Unit="s"  % Vehicle-dynamics state time.
  LongitudinalSpeed: single, Unit="m/s"  % Body-frame forward speed.
  LateralSpeed: single, Unit="m/s"  % Body-frame leftward speed.
  SideslipAngle: single, Unit="rad"  % Vehicle centre-of-mass sideslip angle.
  FrontSlipAngle: single, Unit="rad"  % Front-tyre slip angle.
  RearSlipAngle: single, Unit="rad"  % Rear-tyre slip angle.
  YawAcceleration: single, Unit="rad/s^2"  % Yaw angular acceleration.
  LongitudinalAcceleration: single, Unit="m/s^2"  % Body-frame inertial longitudinal acceleration.
  LateralAcceleration: single, Unit="m/s^2"  % Body-frame inertial lateral acceleration.
  FrictionUtilization: single  % Combined force divided by friction capacity.
  SteeringState: single, Unit="rad"  % Simulated road-wheel steering state.
  ResetApplied: boolean  % True when initial state was loaded this sample.
  TireForceSaturated: boolean  % True when a tyre or friction-circle force was limited.
  Valid: boolean  % True when the simulated state is finite and usable.

RsSafetyStatusBus = Simulink.Bus()  % Independent safety decision, trigger evidence, and override state.
  Timestamp: double, Unit="s"  % Safety-supervisor decision time.
  SequenceID: uint32  % Incremented whenever the safety state changes.
  State: Enum: RoadsenseTypes.SafetyState  % Active independent safety state.
  ReasonMask: uint16  % Safety causes: invalid=1, stale=2, collision=4, requested=8, tracking=16, instability=32, saturation=64, deadline=128, high-risk=256.
  MinimumTTC: single, Unit="s"  % Independent minimum forward time to collision.
  NearestDistance: single, Unit="m"  % Nearest relevant forward-object clearance.
  MaximumInputAge: single, Unit="s"  % Largest nonnegative monitored signal age.
  CrossTrackError: single, Unit="m"  % Controller-reported signed cross-track error.
  SideslipAngle: single, Unit="rad"  % Vehicle-model centre-of-mass sideslip.
  FrictionUtilization: single  % Vehicle combined-friction utilization.
  OverrideActive: boolean  % True when nominal control was modified.
  EmergencyLatched: boolean  % True while emergency braking is held after its trigger clears.
  SafeToDrive: boolean  % True only in Normal or Degraded with valid monitored inputs.
  Valid: boolean  % True when the supervisor emitted a deterministic decision.

RsIntegrationStatusBus = Simulink.Bus()  % End-to-end health, readiness, intervention, and completion summary.
  Timestamp: double, Unit="s"  % Current closed-loop vehicle time.
  CycleID: uint32  % Monotonically increasing 50 Hz integration cycle identifier.
  PerceptionValid: boolean  % True when camera and LiDAR perception outputs are usable.
  FusionValid: boolean  % True when the fused-track list is usable.
  PredictionValid: boolean  % True when the motion-prediction list is usable.
  MapValid: boolean  % True when the semantic occupancy grid is usable.
  BehaviourValid: boolean  % True when the behaviour command is usable.
  PlanValid: boolean  % True when the local plan and planner status are usable.
  TrackingValid: boolean  % True when nominal control and tracking status are usable.
  SafetyValid: boolean  % True when safety status and the gated command are usable.
  VehicleValid: boolean  % True when ego state and vehicle-dynamics status are usable.
  PipelineReady: boolean  % True when every closed-loop component is currently usable.
  SafetyOverride: boolean  % True when the safety supervisor is modifying nominal control.
  EmergencyStop: boolean  % True when the final command requests fail-safe braking.
  GoalReached: boolean  % True when valid route context reports completion.
  Valid: boolean  % True when the integration monitor emitted a deterministic status.

RsScenarioDefinitionBus = Simulink.Bus()  % Static or slowly varying scenario definition consumed by scenario adapters.
  Timestamp: double, Unit="s"  % Scenario-definition update time.
  ScenarioID: uint16  % Identifier changed whenever a scenario is restarted or replaced.
  Count: uint16  % Number of valid leading world-route points.
  WorldPositions: double[256 3], Unit="m"  % World-frame route points [x y z].
  RecommendedSpeeds: single[256 1], Unit="m/s"  % Route speed recommendation at each point.
  ValidMask: boolean[256 1]  % True for each populated route-point slot.
  DesiredSpeed: single, Unit="m/s"  % Scenario free-flow speed request.
  SpeedLimit: single, Unit="m/s"  % Scenario speed limit.
  GoalRadius: single, Unit="m"  % Distance from final point considered goal completion.
  AllowObstacleAvoidance: boolean  % True when leaving the route centreline to avoid obstacles is permitted.
  UncontrolledIntersection: boolean  % True in an unsignalized or informally controlled junction.
  OccludedArea: boolean  % True when scenario visibility requires cautious entry.
  MergeRequired: boolean  % True while the scenario requires an informal or highway merge.
  InitialPosition: double[3 1], Unit="m"  % Initial ego world position [x;y;z].
  InitialYaw: double, Unit="rad"  % Initial ego world heading.
  InitialSpeed: single, Unit="m/s"  % Initial ego longitudinal speed.
  FrictionCoefficient: single  % Tyre-road friction coefficient.
  Grade: single, Unit="rad"  % Positive uphill road grade.
  Bank: single, Unit="rad"  % Positive left-up road bank.
  RollingResistance: single  % Road rolling-resistance coefficient.
  Valid: boolean  % True when route, initialization, and road fields are usable.

RsScenarioActorListBus = Simulink.Bus()  % Fixed-capacity world-frame truth actors used by synthetic sensors and validation.
  Timestamp: double, Unit="s"  % Scenario truth-sample time.
  Count: uint16  % Number of valid leading actor entries.
  ActorIDs: uint32[64 1]  % Persistent scenario actor identifiers.
  ClassIDs: uint8[64 1]  % Numeric RoadsenseTypes.ObjectClass codes.
  Positions: double[64 3], Unit="m"  % Actor world-frame positions [x y z].
  Velocities: single[64 3], Unit="m/s"  % Actor world-frame Cartesian velocities.
  Yaws: single[64 1], Unit="rad"  % Actor world-frame headings.
  Dimensions: single[64 3], Unit="m"  % Actor [length width height].
  ValidMask: boolean[64 1]  % True for each active actor slot.
  Overflow: boolean  % True when active actors exceeded fixed capacity.
  Valid: boolean  % True when scenario truth is usable.

RsScenarioStatusBus = Simulink.Bus()  % Scenario selection, timing, event, and actor-count summary.
  Timestamp: double, Unit="s"  % Scenario-library sample time.
  ScenarioID: uint16  % Selected scenario identifier.
  ElapsedTime: single, Unit="s"  % Time since scenario start.
  Duration: single, Unit="s"  % Configured scenario duration.
  EventMask: uint16  % Active events: running=1, unstructured=2, merge=4, pedestrian=8, animal=16, slow vehicle=32, surface hazard=64, complete=128.
  ActiveActorCount: uint16  % Number of active truth actors.
  Valid: boolean  % True when a supported scenario is selected.

RsScenarioSensorStatusBus = Simulink.Bus()  % Visibility, occlusion, and dropout evidence from the synthetic scenario sensors.
  Timestamp: double, Unit="s"  % Synthetic sensor-source sample time.
  ScenarioID: uint16  % Scenario identifier associated with the measurements.
  CameraVisibleCount: uint16  % Actors rendered into the camera image.
  LidarVisibleCount: uint16  % Actors represented in the LiDAR point cloud.
  RadarVisibleCount: uint16  % Actors reported by radar after deterministic missed detections.
  OccludedCount: uint16  % In-range actors suppressed by angular occlusion.
  CameraDropout: boolean  % True during a configured camera dropout window.
  LidarDropout: boolean  % True during a configured LiDAR dropout window.
  RadarDropout: boolean  % True during a configured radar dropout window.
  Valid: boolean  % True when ego, truth, scenario, and generated measurements are usable.

RsScenarioEvaluationBus = Simulink.Bus()  % Truth-isolated closed-loop scenario completion, safety, timing, and comfort metrics.
  Timestamp: double, Unit="s"  % Current evaluation time.
  ScenarioID: uint16  % Scenario being evaluated.
  ElapsedTime: single, Unit="s"  % Elapsed scenario time.
  MinimumClearance: single, Unit="m"  % Minimum truth-based footprint clearance observed so far.
  Collision: boolean  % True once truth footprints overlap.
  GoalReached: boolean  % True once the route adapter reports goal completion.
  ScenarioFinished: boolean  % True once configured scenario duration is reached.
  ReplanCount: uint32  % Number of distinct nonzero plan identifiers observed.
  LastReplanLatency: single, Unit="s"  % Execution time of the newest plan.
  MaximumReplanLatency: single, Unit="s"  % Largest local-planner execution time observed.
  PathSmoothness: single, Unit="1/m"  % Largest RMS absolute curvature observed across valid plans.
  MaximumJerk: single, Unit="m/s^3"  % Largest final-command acceleration slew observed.
  MaximumCrossTrackError: single, Unit="m"  % Largest absolute tracking error observed.
  SafetyInterventionCount: uint32  % Number of safety-override rising edges.
  PipelineReadyRatio: single, Min=0, Max=1  % Fraction of evaluated ticks with the complete pipeline ready.
  SensorDropoutMask: uint8  % Current dropout bits: camera=1, LiDAR=2, radar=4.
  Pass: boolean  % True at scenario finish when every acceptance criterion passes.
  Valid: boolean  % True when evaluation inputs and accumulated metrics are usable.

RsContractVersion = Simulink.Parameter(uint32(16))  % Shared interface revision.
RsMaxDetections = Simulink.Parameter(uint16(256))  % Fixed detection-array capacity.
RsMaxTracks = Simulink.Parameter(uint16(128))  % Fixed track-array capacity.
RsMaxPredictionModes = Simulink.Parameter(uint8(4))  % Maximum modes per predicted object.
RsPredictionSteps = Simulink.Parameter(uint8(16))  % Number of prediction time samples.
RsPredictionStep = Simulink.Parameter(single(0.2), Unit="s")  % Prediction interval in seconds.
RsPredictionHorizon = Simulink.Parameter(single(3), Unit="s")  % Prediction horizon in seconds.
RsPredictionHistoryGain = Simulink.Parameter(single(0.35))  % Update gain for inferred acceleration and yaw rate.
RsPredictionVehicleTurnRate = Simulink.Parameter(single(0.25), Unit="rad/s")  % Alternative vehicle turn-rate magnitude.
RsPredictionVulnerableTurnRate = Simulink.Parameter(single(0.65), Unit="rad/s")  % Pedestrian/cyclist/animal alternative turn-rate magnitude.
RsPredictionVehicleBrake = Simulink.Parameter(single(-3), Unit="m/s^2")  % Vehicle braking-mode acceleration.
RsPredictionVulnerableBrake = Simulink.Parameter(single(-1.5), Unit="m/s^2")  % Vulnerable-user stopping-mode acceleration.
RsPredictionMinimumModeProbability = Simulink.Parameter(single(0.03))  % Probability floor for active alternative modes.
RsMaxPlanPoints = Simulink.Parameter(uint16(61))  % Fixed planned-trajectory capacity.
RsMaxReferencePoints = Simulink.Parameter(uint16(256))  % Fixed reference-path capacity.
RsMaxScenarioActors = Simulink.Parameter(uint16(64))  % Fixed scenario truth-actor capacity.
RsPlanStep = Simulink.Parameter(single(0.1), Unit="s")  % Local trajectory time interval.
RsPlanHorizon = Simulink.Parameter(single(6), Unit="s")  % Local trajectory horizon.
RsPlannerLateralTransitionDistance = Simulink.Parameter(single(10), Unit="m")  % Distance used to blend from the route center to a sampled avoidance offset.
RsPlannerLateralOffsets = Simulink.Parameter(single([-4; -2; -1; 0; 1; 2; 4]), Unit="m")  % Sampled lateral route offsets.
RsPlannerSpeedScales = Simulink.Parameter(single([0.7; 1; 1.15]))  % Sampled fractions of behaviour target speed.
RsPlannerWheelbase = Simulink.Parameter(single(2.8), Unit="m")  % Bicycle-model wheelbase.
RsPlannerVehicleLength = Simulink.Parameter(single(4.6), Unit="m")  % Ego collision-footprint length.
RsPlannerVehicleWidth = Simulink.Parameter(single(1.9), Unit="m")  % Ego collision-footprint width.
RsPlannerMaximumCurvature = Simulink.Parameter(single(0.22), Unit="1/m")  % Maximum feasible absolute path curvature.
RsPlannerMaximumJerk = Simulink.Parameter(single(2.5), Unit="m/s^3")  % Maximum longitudinal jerk magnitude.
RsPlannerHardOccupancy = Simulink.Parameter(single(0.65))  % Static occupancy producing hard collision rejection.
RsPlannerCollisionProbability = Simulink.Parameter(single(0.05))  % Minimum object-mode probability enforced as a hard collision constraint.
RsPlannerPredictionSigma = Simulink.Parameter(single(2))  % Prediction covariance inflation used in collision checking.
RsPlannerMaximumLongitudinalInflation = Simulink.Parameter(single(3), Unit="m")  % Maximum hard-collision longitudinal uncertainty inflation.
RsPlannerMaximumLateralInflation = Simulink.Parameter(single(2.5), Unit="m")  % Maximum hard-collision lateral uncertainty inflation.
RsPlannerLateralClearanceRatio = Simulink.Parameter(single(0.35))  % Fraction of following clearance retained as lateral passing clearance.
RsPlannerMaximumLateralClearance = Simulink.Parameter(single(0.8), Unit="m")  % Maximum explicit lateral passing clearance in addition to uncertainty inflation.
RsPlannerDeadline = Simulink.Parameter(single(0.1), Unit="s")  % Allowed local-planning latency.
RsControllerWheelbase = Simulink.Parameter(single(2.8), Unit="m")  % Trajectory-controller bicycle-model wheelbase.
RsControllerLateralGain = Simulink.Parameter(single(2.2), Unit="1/s")  % Cross-track feedback gain.
RsControllerHeadingGain = Simulink.Parameter(single(1.2))  % Heading-error feedback gain.
RsControllerSofteningSpeed = Simulink.Parameter(single(2), Unit="m/s")  % Low-speed denominator softening.
RsControllerSpeedKp = Simulink.Parameter(single(0.8), Unit="1/s")  % Longitudinal proportional speed gain.
RsControllerSpeedKi = Simulink.Parameter(single(0.15), Unit="1/s^2")  % Longitudinal integral speed gain.
RsControllerIntegralLimit = Simulink.Parameter(single(3), Unit="m*s")  % Absolute speed-error integral limit.
RsControllerMaximumSteering = Simulink.Parameter(single(0.55), Unit="rad")  % Absolute road-wheel steering limit.
RsControllerMaximumSteeringRate = Simulink.Parameter(single(0.7), Unit="rad/s")  % Absolute steering slew rate.
RsControllerMaximumAcceleration = Simulink.Parameter(single(3), Unit="m/s^2")  % Maximum propulsion acceleration request.
RsControllerMaximumDeceleration = Simulink.Parameter(single(6), Unit="m/s^2")  % Maximum service-braking deceleration magnitude.
RsControllerAccelerationSlew = Simulink.Parameter(single(5), Unit="m/s^3")  % Normal acceleration-command slew limit.
RsControllerPreviewTime = Simulink.Parameter(single(1), Unit="s")  % Time preview used for trajectory reference selection.
RsControllerPlanGrace = Simulink.Parameter(single(0.25), Unit="s")  % Allowed age beyond the final plan sample.
RsVehicleMass = Simulink.Parameter(single(1650), Unit="kg")  % Ego vehicle mass.
RsVehicleYawInertia = Simulink.Parameter(single(2800), Unit="kg*m^2")  % Ego yaw moment of inertia.
RsVehicleFrontAxleDistance = Simulink.Parameter(single(1.2), Unit="m")  % Centre-of-mass to front axle.
RsVehicleRearAxleDistance = Simulink.Parameter(single(1.6), Unit="m")  % Centre-of-mass to rear axle.
RsVehicleFrontCorneringStiffness = Simulink.Parameter(single(80000), Unit="N/rad")  % Front-axle cornering stiffness.
RsVehicleRearCorneringStiffness = Simulink.Parameter(single(85000), Unit="N/rad")  % Rear-axle cornering stiffness.
RsVehicleSteeringTimeConstant = Simulink.Parameter(single(0.08), Unit="s")  % First-order steering actuator time constant.
RsVehicleAccelerationTimeConstant = Simulink.Parameter(single(0.15), Unit="s")  % First-order longitudinal actuator time constant.
RsVehicleMaximumSteeringRate = Simulink.Parameter(single(1), Unit="rad/s")  % Plant steering-rate limit.
RsVehicleMaximumJerk = Simulink.Parameter(single(10), Unit="m/s^3")  % Plant longitudinal actuator slew limit.
RsVehicleLowSpeedThreshold = Simulink.Parameter(single(2), Unit="m/s")  % Speed below which stabilized kinematic yaw is used.
RsVehicleMaximumSpeed = Simulink.Parameter(single(50), Unit="m/s")  % Simulation speed safety bound.
RsSafetyEmergencyTTC = Simulink.Parameter(single(1), Unit="s")  % Independent emergency TTC threshold.
RsSafetyEmergencyDistance = Simulink.Parameter(single(2.5), Unit="m")  % Immediate forward-clearance emergency threshold.
RsSafetyControlStaleTime = Simulink.Parameter(single(0.1), Unit="s")  % Maximum nominal-control age.
RsSafetyTrackingStaleTime = Simulink.Parameter(single(0.1), Unit="s")  % Maximum tracking/dynamics status age.
RsSafetyPerceptionStaleTime = Simulink.Parameter(single(0.25), Unit="s")  % Maximum map/track age.
RsSafetyPlanningStaleTime = Simulink.Parameter(single(0.3), Unit="s")  % Maximum behaviour/planner age.
RsSafetyCrossTrackWarning = Simulink.Parameter(single(0.75), Unit="m")  % Cross-track error entering degraded mode.
RsSafetyCrossTrackFault = Simulink.Parameter(single(2.5), Unit="m")  % Cross-track error requiring a minimal-risk stop during lane-free avoidance.
RsSafetyHeadingWarning = Simulink.Parameter(single(0.2), Unit="rad")  % Heading error entering degraded mode.
RsSafetyHeadingFault = Simulink.Parameter(single(0.6), Unit="rad")  % Heading error requiring a minimal-risk stop.
RsSafetySideslipWarning = Simulink.Parameter(single(0.1), Unit="rad")  % Sideslip entering degraded mode.
RsSafetySideslipFault = Simulink.Parameter(single(0.18), Unit="rad")  % Sideslip requiring a minimal-risk stop.
RsSafetyFrictionWarning = Simulink.Parameter(single(0.85))  % Friction utilization entering degraded mode.
RsSafetyLateralAccelerationFault = Simulink.Parameter(single(7), Unit="m/s^2")  % Lateral acceleration requiring a minimal-risk stop.
RsSafetyDegradedSpeed = Simulink.Parameter(single(4), Unit="m/s")  % Maximum desired speed in degraded mode.
RsSafetyMinimalRiskDeceleration = Simulink.Parameter(single(3), Unit="m/s^2")  % Minimal-risk stopping deceleration magnitude.
RsSafetyEmergencyHoldTicks = Simulink.Parameter(uint16(50))  % Minimum emergency hold at the 50 Hz control rate.
RsSafetyRecoveryTicks = Simulink.Parameter(uint16(25))  % Healthy standstill samples required before release.
RsCameraImageHeight = Simulink.Parameter(uint16(480))  % Camera input image height in pixels.
RsCameraImageWidth = Simulink.Parameter(uint16(640))  % Camera input image width in pixels.
RsSemanticOutputHeight = Simulink.Parameter(uint16(120))  % Semantic evidence height in pixels.
RsSemanticOutputWidth = Simulink.Parameter(uint16(160))  % Semantic evidence width in pixels.
RsSemanticMinConfidence = Simulink.Parameter(single(0.45))  % Minimum accepted semantic-object confidence.
RsSemanticMinBlobArea = Simulink.Parameter(uint32(60))  % Minimum connected-component area in squared network pixels.
RsCameraFocalLength = Simulink.Parameter(single([400; 400]))  % Camera focal lengths [fx;fy] in pixels.
RsCameraPrincipalPoint = Simulink.Parameter(single([319.5; 239.5]))  % Camera principal point [cx;cy] in pixels.
RsCameraHeight = Simulink.Parameter(single(1.4), Unit="m")  % Camera height above nominal ground.
RsCameraPitchDown = Simulink.Parameter(single(0.0872664601), Unit="rad")  % Positive downward camera pitch.
RsScenarioCameraHorizontalFOV = Simulink.Parameter(single(1.57079637), Unit="rad")  % Synthetic camera horizontal field of view.
RsScenarioCameraRange = Simulink.Parameter(single(80), Unit="m")  % Maximum synthetic camera actor range.
RsTsSemanticInference = Simulink.Parameter(0.1, DataType="double", Unit="s")  % Semantic network execution period.
RsMaxLidarPoints = Simulink.Parameter(uint32(120000))  % Fixed normalized point-cloud capacity.
RsLidarZLimits = Simulink.Parameter(single([-3; 5]), Unit="m")  % Accepted vertical LiDAR ROI.
RsLidarSMRFResolution = Simulink.Parameter(single(0.5), Unit="m")  % SMRF ground-grid resolution.
RsLidarSMRFSlopeThreshold = Simulink.Parameter(single(0.2))  % SMRF maximum local ground slope.
RsLidarSMRFElevationThreshold = Simulink.Parameter(single(0.3), Unit="m")  % SMRF ground elevation threshold.
RsLidarClusterDistance = Simulink.Parameter(single(0.75), Unit="m")  % Euclidean cluster separation.
RsLidarMinClusterPoints = Simulink.Parameter(uint16(8))  % Minimum points accepted as an object cluster.
RsLidarMaxClusterPoints = Simulink.Parameter(uint32(20000))  % Maximum points accepted in one object cluster.
RsPotholeDepthThreshold = Simulink.Parameter(single(0.08), Unit="m")  % Minimum surface depression depth.
RsRoughnessThreshold = Simulink.Parameter(single(0.05), Unit="m")  % Ground-height roughness producing elevated cost.
RsTsLidarPerception = Simulink.Parameter(0.1, DataType="double", Unit="s")  % LiDAR perception execution period.
RsScenarioLidarRange = Simulink.Parameter(single(70), Unit="m")  % Maximum synthetic LiDAR actor range.
RsScenarioRadarRange = Simulink.Parameter(single(150), Unit="m")  % Maximum synthetic radar actor range.
RsScenarioRadarPositionSigma = Simulink.Parameter(single([0.35; 0.25; 0.5]), Unit="m")  % Synthetic radar Cartesian position standard deviation.
RsScenarioRadarVelocitySigma = Simulink.Parameter(single([0.4; 0.3; 0.5]), Unit="m/s")  % Synthetic radar Cartesian velocity standard deviation.
RsScenarioMinimumClearance = Simulink.Parameter(single(0.1), Unit="m")  % Required non-collision truth clearance.
RsScenarioMaximumReplanLatency = Simulink.Parameter(single(0.1), Unit="s")  % Maximum accepted local-planner execution time.
RsScenarioMaximumPathCurvatureRMS = Simulink.Parameter(single(0.18), Unit="1/m")  % Maximum accepted RMS path curvature.
RsScenarioMaximumJerk = Simulink.Parameter(single(10), Unit="m/s^3")  % Maximum accepted final-command acceleration slew.
RsScenarioMaximumCrossTrackError = Simulink.Parameter(single(3), Unit="m")  % Maximum accepted absolute tracking error during lane-free avoidance.
RsScenarioMinimumReadyRatio = Simulink.Parameter(single(0.7))  % Minimum accepted fraction of pipeline-ready evaluation ticks.
RsFusionCameraLidarGate = Simulink.Parameter(single(4), Unit="m")  % Maximum camera-to-LiDAR pre-association distance.
RsFusionRadarLidarGate = Simulink.Parameter(single(2.5), Unit="m")  % Maximum radar-to-LiDAR pre-association distance.
RsFusionCameraRadarGate = Simulink.Parameter(single(4.5), Unit="m")  % Maximum camera-to-radar pre-association distance.
RsFusionTrackAssociationThreshold = Simulink.Parameter(single([12; 30]))  % JPDA assignment and maximum thresholds.
RsFusionConfirmationProbability = Simulink.Parameter(single(0.85))  % JIPDA probability required to confirm a track.
RsFusionDeletionProbability = Simulink.Parameter(single(0.005))  % JIPDA probability below which a track is deleted.
RsFusionDetectionProbability = Simulink.Parameter(single(0.8))  % Conservative per-update detection probability accounting for urban occlusion.
RsFusionCoastTime = Simulink.Parameter(single(1), Unit="s")  % Target track persistence through temporary sensor dropout.
RsMapUnknownDrivability = Simulink.Parameter(single(0.35))  % Conservative drivability assigned to unobserved cells.
RsMapCameraMinConfidence = Simulink.Parameter(single(0.25))  % Minimum semantic confidence projected onto the ground grid.
RsMapCurrentSafetyMargin = Simulink.Parameter(single(0.5), Unit="m")  % Footprint inflation around current tracked objects.
RsMapMaximumCurrentInflation = Simulink.Parameter(single(2), Unit="m")  % Maximum covariance-derived current-object map inflation.
RsMapPredictionSigma = Simulink.Parameter(single(2.5))  % Gaussian sigma extent rasterized for predicted risk.
RsMapMaximumPredictionRadius = Simulink.Parameter(single(8), Unit="m")  % Maximum radius rasterized for a predicted-risk sample.
RsMapPredictionTimeDecay = Simulink.Parameter(single(3), Unit="s")  % Time constant for future-risk discounting.
RsMapPotholeThreshold = Simulink.Parameter(single(0.3))  % Pothole probability that assigns the pothole semantic label.
RsBehaviourReactionTime = Simulink.Parameter(single(0.6), Unit="s")  % Reaction allowance used in stopping distance.
RsBehaviourEmergencyDeceleration = Simulink.Parameter(single(6), Unit="m/s^2")  % Positive emergency-deceleration magnitude.
RsBehaviourComfortDeceleration = Simulink.Parameter(single(3), Unit="m/s^2")  % Positive comfortable-deceleration magnitude.
RsBehaviourEmergencyTTC = Simulink.Parameter(single(1.2), Unit="s")  % TTC threshold for emergency braking.
RsBehaviourFollowTimeGap = Simulink.Parameter(single(1.8), Unit="s")  % Desired following time gap.
RsBehaviourCreepSpeed = Simulink.Parameter(single(1.2), Unit="m/s")  % Occlusion-aware creep speed.
RsBehaviourCautiousSpeed = Simulink.Parameter(single(5), Unit="m/s")  % Maximum cautious-mode speed.
RsBehaviourAvoidSpeed = Simulink.Parameter(single(4), Unit="m/s")  % Maximum obstacle-avoidance speed.
RsBehaviourEmergencyHoldTicks = Simulink.Parameter(uint16(5))  % Minimum emergency-mode hold at the planning rate.
RsBehaviourYieldClearTicks = Simulink.Parameter(uint16(8))  % Clear samples required before leaving Yield.
RsGridResolution = Simulink.Parameter(single(0.25), Unit="m")  % Semantic grid resolution.
RsGridXLimits = Simulink.Parameter(single([-20; 60]), Unit="m")  % Grid longitudinal limits.
RsGridYLimits = Simulink.Parameter(single([-25; 25]), Unit="m")  % Grid lateral limits.
RsGridRows = Simulink.Parameter(uint16(200))  % Semantic grid row count.
RsGridCols = Simulink.Parameter(uint16(320))  % Semantic grid column count.
RsTsBase = Simulink.Parameter(0.01, DataType="double", Unit="s")  % Fundamental discrete scheduler step.
RsTsPerception = Simulink.Parameter(0.05, DataType="double", Unit="s")  % Camera and lidar perception sample time.
RsTsFusion = Simulink.Parameter(0.05, DataType="double", Unit="s")  % Sensor-fusion sample time.
RsTsMap = Simulink.Parameter(0.1, DataType="double", Unit="s")  % Traversability-map sample time.
RsTsPrediction = Simulink.Parameter(0.1, DataType="double", Unit="s")  % Motion-prediction sample time.
RsTsPlanning = Simulink.Parameter(0.1, DataType="double", Unit="s")  % Behaviour and local-planning sample time.
RsTsControl = Simulink.Parameter(0.02, DataType="double", Unit="s")  % Vehicle-control sample time.
RsTsScenario = Simulink.Parameter(0.1, DataType="double", Unit="s")  % Scenario-library and truth update period.